# Grasshopper definition saverioMask2.gh (Grasshopper 1.0.4)

mesh = Mesh(<mesh referenced from the Rhino model>)

mesh_2 = Mesh(<mesh referenced from the Rhino model>)
facen = FaceNormals(Mesh=mesh_2)  # -> Centers, Normals
faceb = FaceBoundaries(Mesh=mesh_2)
vec = Vector(facen.Normals)
jitter = Jitter(List=facen.Centers, Jitter=Slider(0.495, range=0..1), Seed=2)  # -> Values, Indices
division = Division(A=jitter.Indices, B=Slider(20, range=1..20))
amp = Amplitude(Vector=vec, Amplitude=division)
vlen = VectorLength(Vector=amp)
line = LineSDL(Start=facen.Centers, Direction=amp, Length=vlen)
end = EndPoints(Curve=line)  # -> Start, End
extr = ExtrudePoint(Base=faceb, Point=end.End)

faceb_2 = FaceBoundaries(Mesh=mesh)
facen_2 = FaceNormals(Mesh=mesh)  # -> Centers, Normals
vec_2 = Vector(facen_2.Normals)
amp_2 = Amplitude(Vector=vec_2, Amplitude=Slider(10, range=0..20))
neg = Negative(Value=amp_2)
vlen_2 = VectorLength(Vector=amp_2)
line_2 = LineSDL(Start=facen_2.Centers, Direction=amp_2, Length=vlen_2)
end_2 = EndPoints(Curve=line_2)  # -> Start, End
extr_2 = ExtrudePoint(Base=faceb_2, Point=end_2.End)
